# Grasshopper definition tile.gh (Grasshopper 0.9.80)

number_slider = Slider(37, range=0..100)
xy_plane = XYPlane(Origin=Point(0, 0, 0))
pi = Pi(Factor=Slider(8, range=0..10))
circle = Circle(Plane=xy_plane, Radius=Slider(6, range=0..10))
range = Range(Domain=pi, Steps=number_slider)
divide_curve = DivideCurve(Curve=circle, Count=number_slider, Kinks=False)  # -> Points, Tangents, Parameters
cull_index = CullIndex(List=range, Indices=-1, Wrap=True)
sine = Sine(Value=cull_index)
multiplication = Multiplication(A=sine, B=Slider(1.29, range=0..10))
unit_z = UnitZ(Factor=multiplication)
move = Move(Geometry=divide_curve.Points, Motion=unit_z)  # -> Geometry, Transform
interpolate = Interpolate(Vertices=move.Geometry, Degree=3, Periodic=False, KnotStyle=1)  # -> Curve, Length, Domain
loft = Loft(
    Curves=interpolate.Curve,
    Options={Adjust=False, Closed=False, LoftEnds=0, LoftSimp=0, LoftType=0, Rebuild=10, Refit=0.01})

main_square_height_width = Number(Slider(20.952, range=0..100))
detail_depth = Number(Slider(1.702, range=0..100))
tiny_planet_radius = Number(Slider(4.36, range=0..100))
tile_base_thickness = Number(Slider(3.158, range=0..100))
main_square_height_width_2 = Number(main_square_height_width)
sqrt_2 = Number(1.414213562)
multiplication_2 = Multiplication(A=main_square_height_width_2, B=sqrt_2)
rectangle = Rectangle(Plane=PlaneXY(0, 0, 0), XSize=multiplication_2, YSize=multiplication_2, Radius=0)  # -> Rectangle, Length
number_slider_2 = Slider(2, range=0..10)
secondary_tile_bounding_box = Geometry(rectangle.Rectangle)
rectangle_2 = Rectangle(Plane=PlaneXY(0, 0, 0), XSize=Domain(-1, 1), YSize=Domain(-2, 2), Radius=0)  # -> Rectangle, Length
vector_xyz = VectorXYZ(XComponent=0, YComponent=0, ZComponent=0)  # -> Vector, Length
extrude = Extrude(Base=rectangle_2.Rectangle, Direction=vector_xyz.Vector)
solid_difference = SolidDifference()

# ---- group: preview
md_slider = MDSlider(
    slider_value=Point(0.5182338808, 0.4733898814, 0.5),
    SliderMode=0,
    x_domain=Domain(-1000, 1000),
    y_domain=Domain(-1000, 1000),
    z_domain=Domain(0, 1))
final = Geometry()
move_2 = Move(Geometry=final, Motion=md_slider)  # -> Geometry, Transform
preview = Geometry(move_2.Geometry)

# ---- group: tiny planet
tile_base_thickness_2 = Number(tile_base_thickness)
detail_depth_2 = Number(detail_depth)
tiny_planet_radius_2 = Number(tiny_planet_radius)
vector_xyz_2 = VectorXYZ(XComponent=0, YComponent=0, ZComponent=tile_base_thickness_2)  # -> Vector, Length
number = Number(-1)
multiplication_3 = Multiplication(A=detail_depth_2, B=number)
vector_xyz_3 = VectorXYZ(XComponent=0, YComponent=0, ZComponent=multiplication_3)  # -> Vector, Length

# ---- group: base tile
main_square_height_width_3 = Number(main_square_height_width)
tile_base_thickness_3 = Number(tile_base_thickness)
construct_domain = Domain(DomainStart=expr("-x/2", main_square_height_width_3), DomainEnd=expr("x/2", main_square_height_width_3))
rectangle_3 = Rectangle(Plane=PlaneXY(0, 0, 0), XSize=construct_domain, YSize=construct_domain, Radius=0)  # -> Rectangle, Length
duplicate_data = DuplicateData(Data=rectangle_3.Rectangle, Number=2, Order=True)
pi_2 = Pi(Factor=Slider(0.25, range=0..1))
rotate = Rotate(Geometry=duplicate_data, Angle=pi_2, Plane=PlaneXY(0, 0, 0))  # -> Geometry, Transform
vector_xyz_4 = VectorXYZ(XComponent=0, YComponent=0, ZComponent=tile_base_thickness_3)  # -> Vector, Length

# ---- group: tiny planet (continued)
base_square = Geometry(rectangle_3.Rectangle)
polygon_center = PolygonCenter(Polyline=base_square)  # -> CenterV, CenterE, CenterA
circle_cnr = CircleCNR(Center=polygon_center.CenterA, Normal=Vector(0, 0, 1), Radius=tiny_planet_radius_2)
move_3 = Move(Geometry=circle_cnr, Motion=vector_xyz_2.Vector)  # -> Geometry, Transform
extrude_2 = Extrude(Base=move_3.Geometry, Direction=vector_xyz_3.Vector)
tiny_planet = Geometry(extrude_2)

# ---- group: circular caps
main_square_height_width_4 = Number(main_square_height_width)
multiplication_4 = Multiplication(A=main_square_height_width_4, B=Slider(-0.5, range=-1..1))
multiplication_5 = Multiplication(A=main_square_height_width_4, B=Slider(0.5, range=0..1))
vector_xyz_5 = VectorXYZ(XComponent=multiplication_4, YComponent=0, ZComponent=0)  # -> Vector, Length
vector_xyz_6 = VectorXYZ(XComponent=multiplication_5, YComponent=0, ZComponent=0)  # -> Vector, Length
duplicate_data_2 = DuplicateData(Data=circle_cnr, Number=2, Order=True)
duplicate_data_3 = DuplicateData(Data=duplicate_data_2, Number=2, Order=True)
move_4 = Move(Geometry=duplicate_data_3, Motion=vector_xyz_5.Vector)  # -> Geometry, Transform
move_5 = Move(Geometry=duplicate_data_2, Motion=vector_xyz_6.Vector)  # -> Geometry, Transform
merge = Merge(Data1=move_5.Geometry, Data2=move_4.Geometry)
circular_caps = Geometry(merge)

# ---- group: base tile (continued)
merge_2 = Merge(Data1=rectangle_3.Rectangle, Data2=rotate.Geometry, Data3=circular_caps)
extrude_3 = Extrude(Base=merge_2, Direction=vector_xyz_4.Vector)
cap_holes = CapHoles(Brep=extrude_3)
base = Geometry(cap_holes)

# ----
base_tile = Geometry(base)
rectangular_array = RectangularArray(Geometry=base_tile, Cell=rectangle.Rectangle, XCount=number_slider_2, YCount=number_slider_2)  # -> Geometry, Transform
array = Geometry(rectangular_array.Geometry)
merge_3 = Merge(Data1=tiny_planet)
details = Geometry(merge_3)
solid_difference_2 = SolidDifference(BrepsA=base, BrepsB=details)
tile_1 = Geometry(solid_difference_2)
